# Grasshopper definition SLBlockTest.gh (Grasshopper 1.0.7)

brep = Brep([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])
c_script = CSharpScript(
    Create=Button(),
    BlockBrep=brep,
    Reference="D:\研究所\SLBlock\StringGRxShape_Compiler\bin\Debug\net48\SGSFramework.Core.dll")  # -> DeSLBlock, Geom; inputs BlockBrep: list of Brep
# ---------- c_script: C# usings ----------
using SGSFramework.Core.BlockSetting.BlockBase;
using SGSFramework.Core.BlockSetting;
using System.Linq;
using SGSFramework.Core.Util;
# ---------- c_script: C# ----------
      Ablock = SLBlock.SetShape(BlockBrep.ToArray(), GeneralSetting.SegUnit);
      Ablock.SetBlock();
      DeSLBlock = Ablock;
      Geom = (Ablock as SLBlock).SL_Block;
# ---------- c_script: C# additional code ----------
  Block Ablock = null;
# ---------- end c_script ----------
c_script_2 = CSharpScript(Create=Button(), Reference="D:\研究所\SLBlock\StringGRxShape_Compiler\bin\Debug\net48\SGSFramework.Core.dll")  # -> DeSLBlock, Geom
# ---------- c_script_2: C# usings ----------
using SGSFramework.Core.BlockSetting.BlockBase;
using SGSFramework.Core.BlockSetting;
# ---------- c_script_2: C# ----------
    if(IsConstruct)
    {
      DeSLBlock = Ablock;
      Geom = (Ablock as SLBlock).SL_Block;
    }
    else
    {
      Ablock = new SLBlock(Flip:false);
      Ablock.SetBlock();
      DeSLBlock = Ablock;
      Geom = (Ablock as SLBlock).SL_Block;
      IsConstruct = true;
    }
# ---------- c_script_2: C# additional code ----------
  Block Ablock = null;
  bool IsConstruct = false;
# ---------- end c_script_2 ----------
c_script_3 = CSharpScript(Reference="D:\研究所\SLBlock\StringGRxShape_Compiler\bin\Debug\net48\SGSFramework.Core.dll")  # -> DeSLBlock, Geom
# ---------- c_script_3: C# ----------
    if(IsConstruct)
    {
      DeSLBlock = Ablock;
      Geom = (Ablock as SLBlock).SL_Block;
    }
    else
    {
      Ablock = new SLBlock();
      Ablock.SetBlock();
      DeSLBlock = Ablock;
      Geom = (Ablock as SLBlock).SL_Block;
      IsConstruct = true;
    }
# ---------- c_script_3: C# additional code ----------
  Block Ablock = null;
  bool IsConstruct = false;
# ---------- end c_script_3 ----------
c_script_4 = CSharpScript(
    buttom=Button(),
    Name="SLBlock(1)",
    Reference="D:\研究所\SLBlock\StringGRxShape_Compiler\bin\Debug\net48\SGSFramework.Core.dll")  # inputs buttom: Boolean, Name: list of String
# ---------- c_script_4: C# usings ----------
using SGSFramework.Core.BlockSetting;
# ---------- c_script_4: C# ----------
    if(buttom)
    {
      foreach(var N in Name)
      BlockTable.Remove(N);
    }
# ---------- end c_script_4 ----------
c_script_5 = CSharpScript(Update=Button(), Reference="D:\研究所\SLBlock\StringGRxShape_Compiler\bin\Debug\net48\SGSFramework.Core.dll")  # -> AllBlock
# ---------- c_script_5: C# ----------
    AllBlock = BlockTable.AllBlocks;
# ---------- end c_script_5 ----------
panel = Panel(c_script_2.DeSLBlock)
panel_2 = Panel(c_script.DeSLBlock)
panel_3 = Panel(c_script_3.DeSLBlock)
panel_4 = Panel(c_script_3.Geom)
panel_5 = Panel(c_script_5)
subset = SubList(List=c_script_5, Domain="0 to 2", Wrap=True)  # -> List, Index
panel_6 = Panel("""#defined SLBlock(0)_I I
#defined SLBlock(1)_I I2
#defined SLBlock(2)_I I3
<S> = I <HH> 3 <H> <HH> 3 <HHH>
<H> = H I
<HH> = H I2
<HHH> = H I3""")
c_script_6 = CSharpScript(iSLBlock=c_script_5, Reference="D:\研究所\SLBlock\StringGRxShape_Compiler\bin\Debug\net48\SGSFramework.Core.dll")  # -> Table, Terminals; inputs iSLBlock: list
# ---------- c_script_6: C# usings ----------
using SGSFramework.Core.BlockSetting.BlockBase;
using SGSFramework.Core.BlockSetting.LabelBlockBase;
using SGSFramework.Core.BlockSetting;
using System.Linq;
# ---------- c_script_6: C# ----------
    if(iSLBlock.Count == 0) return;
    List<SLBlock> SLs = iSLBlock.Select(x => x as SLBlock).ToList();

    var SLBlockVoca = new SLBlockVoca(SLs);
    SLBlockVoca.SetUpVocabulary();
    var VocaTable = new LabelBlockTable(new List<LabelBlock>(){SLBlockVoca});
    Terminals = VocaTable.Terminals;
    Table = VocaTable;
# ---------- end c_script_6 ----------
c_script_7 = CSharpScript(Reference="D:\研究所\SLBlock\StringGRxShape_Compiler\bin\Debug\net48\SGSFramework.Core.dll")  # -> DefinedAction
# ---------- c_script_7: C# usings ----------
using SGSFramework.Core.Interpreter.InterpreterReader;
# ---------- c_script_7: C# ----------
    DefinedAction = new DefinedLabelAction();
# ---------- end c_script_7 ----------
panel_7 = Panel(c_script_6.Terminals)
panel_8 = Panel(c_script_7)
c_script_8 = CSharpScript(
    iTable=c_script_6.Table,
    Rule=panel_6,
    Actions=c_script_7,
    Reference="D:\研究所\SLBlock\StringGRxShape_Compiler\bin\Debug\net48\SGSFramework.Core.dll")  # -> CMD, Geoms, Cols; inputs Rule: list of String, Actions: list
# ---------- c_script_8: C# usings ----------
using SGSFramework.Core.Interpreter.InterpreterReader;
using SGSFramework.Core.Interpreter;
using SGSFramework.Core.BlockSetting;
# ---------- c_script_8: C# ----------
    if(iTable == null || Rule.Count == 0) return;
    var SpInterpreter = new ShapeInterpreter(iTable as LabelBlockTable);
    SpInterpreter.AddRule(Rule);
    if(Actions.Count > 0)
      foreach(ActionBase Ac in Actions)
        SpInterpreter.AddAction(Ac);

    SpInterpreter.Run();

    CMD = SpInterpreter.cmd;
    Geoms = SpInterpreter.GetGeometry("<S>");
    Cols = SpInterpreter.GetGeometryColor("<S>");
# ---------- end c_script_8 ----------
preview = CustomPreview(Geometry=c_script_8.Geoms, Material=c_script_8.Cols)
panel_9 = Panel(c_script_8.CMD)
